# Grasshopper definition 01_Assignment.gh (Grasshopper 1.0.7)
# plug-ins: Hops

hops = Hops(
    Radius=Slider(5.5, range=0..10),
    NoOfSides=Slider(6, range=0..10),
    FloorHeight=Slider(3, range=0..10),
    RotationAngle=Slider(90, range=0..100),
    NoOfFloors=Slider(19, range=0..100),
    CacheResultsInMemory=True,
    CacheSolveResults=True,
    RemoteDefinitionLocation="D:\SEM II IAAC\Data Management\01.gh",
    RemoteSolveVersion=(0, 1, 0),
    ShowInput_Enabled=False,
    ShowInput_Path=False,
    SynchronousSolve=True)
